# Grasshopper definition GB-BRE-Overshadowing-Sunlight on Ground.gh (Grasshopper 1.0.7)
# plug-ins: Human, MeshEdit Components, Pufferfish

# ----
# INPUTS
analysis_surface = Surface(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)

# ---- group: Analysis model
surrounding_model_mesh = Mesh([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])
massing_option_mesh = Mesh(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)

# ---- group: Weather File input
panel = Panel("https://energyplus-weather.s3.amazonaws.com/europe_wmo_region_6/GBR/GBR_London.Gatwick.037760_IWEC/GBR_London.Gatwick.037760_IWEC.zip")

# ---- group: Analysis model
massing_option_footprint_crv = Curve(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)

# ----
ladybug = Ladybug_Ladybug()  # -> Vviiiiiiiiiizzz; plug-in component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
honeybee = Honeybee_Honeybee()  # -> Vviiiiiiiiiizzz; plug-in component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

# ---- group: BRE Sun Hours
# "As a check, it is recommended that at
# least half of the amenity areas listed above
# should receive at least two hours of sunlight
# on 21 March." (BRE 209 (2022), p.27)
panel_2 = Panel("3")
panel_3 = Panel("60")
analysisperiod = LBAnalysisPeriod(start_month=panel_2, start_day="21", start_hour="6", end_month="3", end_day="21", end_hour="19", timestep=panel_3)  # -> period, hoys, dates; plug-in component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

# ----
# SUNPATH
downloadepw = LBDownloadWeather(weather_URL=panel)  # -> epw_file, stat_file, ddy_file; plug-in component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
importepw = LBImportEPW(epw_file=downloadepw.epw_file)  # -> location, dry_bulb_temperature, dew_point_temperature, relative_humidity, wind_speed, wind_direction, direct_normal_rad, diffuse_horizontal_rad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; plug-in component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
importloc = LBImportLocation(epw_file=downloadepw.epw_file)  # -> location; plug-in component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

area = Area(Geometry=analysis_surface)  # -> Area, Centroid
srf_centre = Data(area.Centroid)

merge = Merge(Data1=surrounding_model_mesh, Data2=massing_option_mesh)  # -> flatten(Result)
context_model = Data(merge)

sunpath = LBSunPath(location=importloc, hoys=analysisperiod.hoys, center_pt=srf_centre, scale=Slider(2, range=0..10))  # -> report, vectors, altitudes, azimuths, hoys, sun_pts, analemma, daily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; plug-in component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

sun_vectors = Data(sunpath.vectors)
bresunlightaltitude = GhPythonScript(alt=sunpath.altitudes)  # -> flatten(P)
# ---------- bresunlightaltitude: Python ----------
"""
Filtering sun points by altitudes.
-
According to BRE 209 (2022), "Sunlight at an altitude of 10 degrees or less
does not count, because it is likely to be blocked by low-level planting
anyway." (p.27)
-

    Inputs:
        x: The x script variable
        y: The y script variable
    Output:
        a: The a output variable"""

__author__ = "wkarnowka"
__version__ = "2021.04.29"

import rhinoscriptsyntax as rs

P = False
if 10 <= alt <= 170:
    P = True
# ---------- end bresunlightaltitude ----------

cull = CullPattern(List=sun_vectors, CullPattern=bresunlightaltitude)
filtered_sun_vectors = Data(cull)

cull_2 = CullPattern(List=sunpath.sun_pts, CullPattern=bresunlightaltitude)
filtered_sun_pts = Data(cull_2)

# ----
# COMPUTE DIRECT SUN HOURS
number_slider = Slider(0.1, range=0..2)
analysis_surface_2 = Surface(analysis_surface)
context_model_2 = Data(context_model)
sun_vectors_2 = Data(sun_vectors)
directsunhours = LBDirectSunHours(
    vectors=flatten(sun_vectors_2),
    geometry=flatten(analysis_surface_2),
    context=flatten(context_model_2),
    grid_size=Slider(1, range=0..2),
    offset_dist=number_slider,
    cpu_count=Toggle(True),
    run=Toggle(True))  # -> report, points, results, mesh, legend, title, int_mtx; plug-in component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
test_pts = Data(flatten(directsunhours.points))
sun_hour_mesh = Data(flatten(directsunhours.mesh))
sun_hour_results_in_minutes = Data(flatten(directsunhours.results))

# ---- group: Visualise sunpath properties
filtered_sun_pts_2 = Data(filtered_sun_pts)
msphere = MeshSphere(Base=filtered_sun_pts_2, Radius=Slider(2, range=0..10), UCount=10, VCount=20)
geom = Data(msphere)
preview = CustomPreview(Geometry=geom, Material=ColourSwatch(SwatchColor=RGB(255, 226, 3)))

compass_crv = Data(sunpath.compass)
preview_2 = CustomPreview(Geometry=compass_crv, Material=ColourSwatch(SwatchColor=RGB(0, 0, 0)))

analemma_crv = Data(sunpath.analemma)
swatch = ColourSwatch(SwatchColor=RGB(105, 105, 105))
preview_3 = CustomPreview(Geometry=analemma_crv, Material=swatch)

# ----
analemma_crv_2 = Data(sunpath.analemma)

# ---- group: Visualise sunpath properties
analemma_crv_3 = Data(sunpath.daily)
preview_4 = CustomPreview(Geometry=analemma_crv_3, Material=swatch)

# ---- group: Slide this slider to see inidivdual sun position
number_slider_2 = Slider(0, range=0..597)

# ---- group: Sun vectors to Srf centre
srf_centre_2 = Data(srf_centre)
ln = Line(StartPoint=filtered_sun_pts_2, EndPoint=srf_centre_2)
previewlw = CustomPreviewLineweights(Geometry=ln, Shader=ColourSwatch(SwatchColor=RGB(255, 226, 3)), Thickness=Slider(1, range=1..10), Absolute=False)

# ----
item = ListItem(List=geom, Index=number_slider_2, Wrap=True)
preview_5 = CustomPreview(Geometry=item, Material=ColourSwatch(SwatchColor=RGB(255, 95, 3)))

massing_option_footprint_crv_2 = Curve(flatten(massing_option_footprint_crv))
# FILTERING RESULTS
pts = Point(test_pts)
x_y_0 = GhPythonScript(inPt=pts)  # -> outPt; inputs inPt: Point3d
# ---------- x_y_0: Python ----------
import Rhino.Geometry as rg

outPt = rg.Point3d(inPt.X,inPt.Y,0)
# ---------- end x_y_0 ----------
project = Project(Geometry=massing_option_footprint_crv_2, Plane=PlaneXY(0, 0, 0))  # -> Geometry, Transform
incurves = PointInCurves(Point=x_y_0, Curves=project.Geometry)  # -> Relationship, Index, Point

# ---- group: Diving the results into hours
sun_hour_results_in_minutes_2 = Number(sun_hour_results_in_minutes)
time_step = Data(panel_3)
division = Division(A=sun_hour_results_in_minutes_2, B=time_step)
sun_hour_results_in_hrs = Data(division)

# ----
test_pts_2 = Point(test_pts)
ptincrv_pattern = Boolean(incurves.Relationship)
sunlighthoursmesh = Mesh(sun_hour_mesh)

# ---- group: Results mesh - footprints
Z = UnitZ(Factor=0.02)
move = Move(Geometry=sunlighthoursmesh, Motion=Z)  # -> Geometry, Transform
cullf = CullFaces(Mesh=move.Geometry, Pattern=ptincrv_pattern)
filtered_sunlight_hours_mesh = Data(cullf)

# ----
cull_3 = CullPattern(List=sun_hour_results_in_hrs, CullPattern=invert(ptincrv_pattern))
filtered_sun_hour_results_in_hrs = Number(cull_3)

# ---- group: test_pts - footprint
cull_4 = CullPattern(List=test_pts_2, CullPattern=invert(ptincrv_pattern))
filtered_test_pts = Point(cull_4)

# ---- group: Sun hour heatmap
gradient = Gradient(
    LowerLimit=Slider(0, range=0..100),
    UpperLimit=Slider(2, range=0..10),
    Parameter=filtered_sun_hour_results_in_hrs,
    stops=[0: RGB(9, 84, 232), 0.25: RGB(92, 73, 135), 0.517: RGB(237, 57, 7), 0.753: RGB(247, 156, 52), 1: RGB(252, 252, 68)])
explode = MeshExplode(Mesh=filtered_sunlight_hours_mesh, Interpolate=False)
move_2 = Move(Geometry=explode, Motion=Vector(0, 0, 0.3))  # -> Geometry, Transform
geometry_col = Data(gradient)
mcol = MeshColours(Mesh=graft(move_2.Geometry), Colours=graft(geometry_col))  # -> flatten(Mesh)

# ---- group: Colouring analysis srfs based on >2h or <2h
# VISUALISE RESULTS
bre_209_recommendation = Panel("2")
larger = LargerThan(FirstNumber=filtered_sun_hour_results_in_hrs, SecondNumber=bre_209_recommendation)  # -> LargerThan, OrEqualTo
cullf_2 = CullFaces(Mesh=filtered_sunlight_hours_mesh, Pattern=invert(flatten(larger.OrEqualTo)))
cullf_3 = CullFaces(Mesh=filtered_sunlight_hours_mesh, Pattern=flatten(larger.OrEqualTo))

mcol_2 = MeshColours(Mesh=cullf_2, Colours=ColourSwatch(SwatchColor=RGB(255, 255, 0)))
mcol_3 = MeshColours(Mesh=cullf_3, Colours=ColourSwatch(SwatchColor=RGB(28, 137, 243)))

# ----
# VISUALISE SUNPATH
swatch_2 = ColourSwatch(SwatchColor=RGB(0, 0, 0))

# ---- group: Display sun hour results on analysis srfs
roundd = RoundToDecimalPlace(NumberX=filtered_sun_hour_results_in_hrs, DecimalPlace=2, RoundType=0)  # -> Rounded, Difference
# Sunlight  at a specific time of the day
tag = TextTag(Location=filtered_test_pts, Text=roundd.Rounded, Colour=swatch_2)

# ----
# SUMMARY OF RESULTS
avr = Average(Input=filtered_sun_hour_results_in_hrs)
avg_sunlight_hours = Data(avr)
average_sun_hours_across_analysis_srf = Panel(avg_sunlight_hours)

area_2 = Area(Geometry=cullf_2)  # -> Area, Centroid
area_3 = Area(Geometry=filtered_sunlight_hours_mesh)  # -> Area, Centroid
division_2 = Division(A=area_2.Area, B=area_3.Area)
_2h_of_sunhours = Data(division_2)
# Add elements to WINDOW
# 00 Time Period
# 6C Function
proportion_of_analysis_srf_receiving_2h = Panel(_2h_of_sunhours)
