# Grasshopper definition 001-221216-Xmas.gh (Grasshopper 1.0.7)
# plug-ins: OpenNest, Human

# ---- group: Selecting Font
fonts = FontTable()
font_table = Panel(fonts)
item = ListItem(List=font_table, Index=Slider(7, range=0..255), Wrap=True)

# ---- group: Text Inputs
panel = Panel("Wish you")
panel_2 = Panel("Happy")
panel_3 = Panel("Holidays")

# ----
pt = ConstructPoint(XCoordinate=0, YCoordinate=Slider(12, range=0..100), ZCoordinate=0)

pt_2 = ConstructPoint(XCoordinate=0, YCoordinate=Slider(6, range=0..100), ZCoordinate=0)

# ---- group: --- SLIDER TO ANIMATE ---
changing_font_sizes_and_extrusion_height = Slider(2, range=2..29)  # "Changing font sizes and extrusion heights"

# ---- group: Font sizes
upper_domain = Data(changing_font_sizes_and_extrusion_height)
multiplication = Multiplication(A=upper_domain, B=Slider(0.09, range=0..1))
addition = Addition(A=multiplication, B=Slider(1, range=0..1))

# ----
pt_3 = ConstructPoint(XCoordinate=0, YCoordinate=0, ZCoordinate=0)
text = Text(Location=pt, Text=panel, Size=addition, Font=item)
text_2 = Text(Location=pt_2, Text=panel_2, Size=addition, Font=item)
text_3 = Text(Location=pt_3, Text=panel_3, Size=addition, Font=item)

merge = Merge(Data1=text, Data2=text_2, Data3=text_3)
data = Data(merge)
rad = Radians(Degrees=Slider(90, range=0..100))
X = UnitX(Factor=Slider(1, range=0..1))
rot3d = Rotate3D(Geometry=data, Angle=rad, Center=Point(0, 0, 0), Axis=X)  # -> Geometry, Transform
move = Move(Geometry=rot3d.Geometry, Motion=Vector(0, 0, 10))  # -> Geometry, Transform
texts_to_extrude = Data(graft(move.Geometry))

dom = ConstructDomain(DomainStart="1", DomainEnd=changing_font_sizes_and_extrusion_height)
random = Random(Range=dom, Number="29", Seed=changing_font_sizes_and_extrusion_height)
extrusion_heights = Data(graft(random))

# ---- group: Extruding both sides
Y = UnitY(Factor=extrusion_heights)
Y_2 = UnitY(Factor=extrusion_heights)
extr = Extrude(Base=texts_to_extrude, Direction=expr("-0.1*x", Y))
extr_2 = Extrude(Base=texts_to_extrude, Direction=expr("0.1*x", Y_2))
cap = CapHoles(Brep=extr)
cap_2 = CapHoles(Brep=extr_2)
sunion = SolidUnion(Breps=[cap, cap_2])

# ----
extruded_and_capped_texts = Data(flatten(sunion))
maximum_extrusion_at_l0 = Data(changing_font_sizes_and_extrusion_height)
minimum_extrusion_at_l1 = Data("1")
extrusion_heights_2 = Data(flatten(extrusion_heights))
gradient = Gradient(
    LowerLimit=maximum_extrusion_at_l0,
    UpperLimit=minimum_extrusion_at_l1,
    Parameter=extrusion_heights_2,
    stops=[0: RGB(234, 38, 0), 0.25: RGB(234, 126, 0), 0.5: RGB(254, 244, 84), 0.75: RGB(154, 205, 50), 1: RGB(0, 128, 0)])

preview = CustomPreview(Geometry=extruded_and_capped_texts, Material=gradient)
